# Dynamo graph elevacionColumNum_script.dyn (Dynamo 2.3.1.11775)
# packages: Clockwork for Dynamo 2.x 2.4.0, Orchid 200.4.0.7938, Data-Shapes 2021.2.94, Crumple 2022.2.13, BIM4Struc.Productivity 2.2.2, Genius Loci 2020.8.3, archi-lab.net 2022.210.2419

code_block = CodeBlock { "Elevación Columna Numerada"; }
code_block_2 = CodeBlock()
# ---------- code_block_2.designscript (10 lines) ----------
//buttonText
"INICIAR";
//buttonCancel
"CANCELAR";
//maxHeight

//width
440;
//label
180;
# ----------------------------------------
code_block_3 = CodeBlock { "Seleccionar una Columna Numerada:"; }
code_block_4 = CodeBlock { "SELECCIONAR"; }
code_block_5 = CodeBlock { "Structural Columns"; }
byName = Category.ByName(name=code_block_5)
selectmodelelements_data_ordered = Custom[SelectModelElements Data (ordered)](InputName=code_block_3, ButtonText=code_block_4, CategoryFilter=byName)  # package Data-Shapes; Creates a Revit element selection input for UI.MultipleInputForm++ . Check out www.data-shapes.net for more infos!
code_block_6 = CodeBlock { "Orientación Seccion:"; }
code_block_7 = CodeBlock { ["Horizontal","Vertical"]; [0,1]; }
code_block_8 = CodeBlock { 0; }
radiobuttons_data = Custom[RadioButtons Data](InputName=code_block_6, Keys=code_block_7.out0, Values=code_block_7.out1, DefaultValueIndex=code_block_8)  # package Data-Shapes; Create radio buttons input for UI.MultipleInputForm ++ .
code_block_9 = CodeBlock { "Escala:"; }
code_block_10 = CodeBlock()
# ---------- code_block_10.designscript (6 lines) ----------
[
"1:50",
"1:75",
"1:100",
"1:125"
];
# ----------------------------------------
code_block_11 = CodeBlock { ":"; }
split = String.Split(str=code_block_10, separator0=code_block_11)
code_block_12 = CodeBlock { 1; }
getItemAtIndex = List.GetItemAtIndex(list=split@L2, index=code_block_12)
toNumber = String.ToNumber(str=getItemAtIndex)
code_block_13 = CodeBlock { 0; false; }
dropdown_data = Custom[DropDown Data](InputName=code_block_9, Keys=code_block_10, Values=toNumber, DefaultValueIndex=code_block_13.out0, Sorted_optional=code_block_13.out1)  # package Data-Shapes; Create data for DropDown input in UI.MultiInputForm ++ . Check out www.data-shapes.net for more infos.
list_create = List.Create(item0=selectmodelelements_data_ordered, item1=radiobuttons_data, item2=dropdown_data)
inputgroup_data = Custom[InputGroup Data](Inputs=list_create)  # package Data-Shapes; Creates a group of inputs for UI.MultipleInputForm ++ . Check out www.data-shapes.net for more infos !
boolean = BoolSelector(true)
multipleinputform = Custom[MultipleInputForm ++](Description_optional=code_block, ButtonText_optional=code_block_2.out0, Inputs=inputgroup_data, Toggle=boolean, CancelButtonText_optional=code_block_2.out1, Width_optional=code_block_2.out2, LabelWidth_optional=code_block_2.out3)  # package Data-Shapes; Create a form with multiple inputs. see www.data-shapes.net for tutorials and infos!
code_block_14 = CodeBlock(x=multipleinputform.User_Inputs)
# ---------- code_block_14.designscript (13 lines) ----------
x;

[Imperative]
{
	if(x == null)
	{
		return = [[],[],[]];
	}
	else
	{
		return = x;
	}
};
# ----------------------------------------
code_block_15 = CodeBlock(x=code_block_14.out1) { x[0]; }
code_block_16 = CodeBlock { "Numeracion Columna"; }
getParameterValueByName = Element.GetParameterValueByName(element=code_block_15, parameterName=code_block_16)
code_block_17 = CodeBlock { ""; }
eq = getParameterValueByName == code_block_17
anyTrue = Orchid.Common.List.AnyTrue(list=eq)
code_block_18 = CodeBlock(x=anyTrue, y=code_block_14.out1)
# ---------- code_block_18.designscript (14 lines) ----------
x;
y;

[Imperative]
{
	if(x == true)
	{
		return = null;
	}
	else
	{
		return = y;
	}
};
# ----------------------------------------
code_block_19 = CodeBlock(x=code_block_18.out2)  # same code as code_block_14
code_block_20 = CodeBlock(x=code_block_19.out1) { x[0]; }
code_block_21 = CodeBlock { "Column Style"; 1; }
setParameterByName = Element.SetParameterByName(element=code_block_20, parameterName=code_block_21.out0, value=code_block_21.out1)
geometry = Element.Geometry(element=setParameterByName)
flatten = List.Flatten(list=geometry)
location = Custom[Element.Location+](element=setParameterByName)  # package Clockwork for Dynamo 2.x; Returns the location of an element as point, curve or curve loop, along with some booleans to help filtering the results. Unlike the OOTB Element.GetLocation node, it also retunrs sketch lines of sketch-based elements like floor slabs as well as the element's rotation property.
code_block_22 = CodeBlock(x=location.curves)
# ---------- code_block_22.designscript (12 lines) ----------
x;
[Imperative]
{
	if(x == null)
	{
		return = [];
	}
	else
	{
		return = x;
	}
};
# ----------------------------------------
code_block_23 = CodeBlock { 0.5; }
pointAtParameter = Curve.PointAtParameter(curve=code_block_22.out1, param=code_block_23)
activeView = Orchid.RevitProject.Common.Document.ActiveView()
plane = Custom[View.Plane](view=activeView)  # package Clockwork for Dynamo 2.x; Retrieves the plane of a given view
normal = Plane.Normal(plane=plane)
byOriginNormal = Plane.ByOriginNormal(origin=pointAtParameter, normal=normal)
intersect = Geometry.Intersect(geometry=flatten, other=byOriginNormal)
await_ = Orchid.Common.DataStream.Await(pass=setParameterByName, waitFor=intersect)
code_block_24 = CodeBlock { "Column Style"; 0; }
setParameterByName_2 = Element.SetParameterByName(element=await_, parameterName=code_block_24.out0, value=code_block_24.out1)
code_block_25 = CodeBlock { "Error."; }
code_block_26 = CodeBlock(x=code_block_18.out2)
# ---------- code_block_26.designscript (12 lines) ----------
x;
[Imperative]
{
	if (x == null)
	{
		return = "La Columna seleccionada no tienen Numeración.\nLa Columna seleccionada debe haber sido numerada antes de ser elevada.";
	}
	else
	{
		return = [];
	}
};
# ----------------------------------------
uimessenger = Custom[© UIMessenger](title=code_block_25, body=code_block_26.out1)  # package Crumple; Displays a message box with a title/body and OK/cancel button. If OK is selected, the third input's data will be passed through.
code_block_27 = CodeBlock { 0; }
code_block_28 = CodeBlock(x=code_block_19.out1) { x[1]; }
eq_2 = code_block_27 == code_block_28
byBestFitThroughPoints = Line.ByBestFitThroughPoints()  # unwired: bestFitPoints
byJoinedCurves = PolyCurve.ByJoinedCurves()  # unwired: curves
flatten_2 = List.Flatten(list=intersect)
perimeterCurves = Surface.PerimeterCurves(surface=flatten_2)
flatten_3 = List.Flatten(list=perimeterCurves)
function_apply = ApplyFunction(func=byJoinedCurves, arg1=flatten_3)
code_block_29 = CodeBlock(x=function_apply)  # same code as code_block_22
code_block_30 = CodeBlock { 2000; false; }
offset = PolyCurve.Offset(polyCurve=code_block_29.out1, signedDistance=code_block_30.out0, extendCircular=code_block_30.out1)
byPatch = Surface.ByPatch(closedCurve=offset)
code_block_31 = CodeBlock { [0,1]; [0.5,0.5]; }
pointAtParameter_2 = Surface.PointAtParameter(surface=byPatch, u=code_block_31.out0, v=code_block_31.out1, lacing=Longest)
flatten_4 = List.Flatten(list=pointAtParameter_2)
function_apply_2 = ApplyFunction(func=byBestFitThroughPoints, arg1=flatten_4)
byBestFitThroughPoints_2 = Line.ByBestFitThroughPoints()  # unwired: bestFitPoints
code_block_32 = CodeBlock { [0.5,0.5]; [0,1]; }
pointAtParameter_3 = Surface.PointAtParameter(surface=byPatch, u=code_block_32.out0, v=code_block_32.out1, lacing=Longest)
flatten_5 = List.Flatten(list=pointAtParameter_3)
function_apply_3 = ApplyFunction(func=byBestFitThroughPoints_2, arg1=flatten_5)
scopeIf = Custom[ScopeIf+](test=eq_2, True=function_apply_2, False=function_apply_3)  # package Clockwork for Dynamo 2.x; A (hopefully) more robust implementation of ScopeIf. Tests a single boolean and returns a value accordingly.
code_block_33 = CodeBlock(x=byOriginNormal) { x; }
rotationAngle = Custom[Element.RotationAngle](element=code_block_20)  # package BIM4Struc.Productivity; Get the rotation element of a Revit element. The rotation angle is based on the Location.Rotation property in the RevitAPI. If Location is not equal to a LocationPoint (ie. in case of slanted columns) then the Angle will be set to null.
flatten_6 = List.Flatten(list=rotationAngle)
rotate = Geometry.Rotate(geometry=scopeIf, basePlane=code_block_33, degrees=flatten_6)
code_block_34 = CodeBlock(x=rotate) { x; }
direction = Line.Direction(line=code_block_34)
code_block_35 = CodeBlock(x=direction) { x.X; }
code_block_36 = CodeBlock { 0; }
ge = code_block_35 >= code_block_36
reverse = Curve.Reverse(curve=code_block_34)
scopeIf_2 = Custom[ScopeIf+](test=ge, True=reverse, False=code_block_34, lacing=Shortest)
direction_2 = Line.Direction(line=scopeIf_2)
normalized = Vector.Normalized(vector=direction_2)
code_block_37 = CodeBlock(x=normalized) { x.X; }
code_block_38 = CodeBlock { 0; }
eq_3 = code_block_37 == code_block_38
code_block_39 = CodeBlock(x=normalized) { x.Y; }
code_block_40 = CodeBlock { 0; }
gt = code_block_39 > code_block_40
and_ = eq_3 && gt
reverse_2 = Curve.Reverse(curve=scopeIf_2)
scopeIf_3 = Custom[ScopeIf+](test=and_, True=reverse_2, False=scopeIf_2, lacing=Shortest)
code_block_41 = CodeBlock { "Levels"; }
byName_2 = Category.ByName(name=code_block_41)
all_elements_of_category = ElementsOfCategory(Category=byName_2)
elevation = Level.Elevation(level=all_elements_of_category)
minimumItem = List.MinimumItem(list=elevation)
eq_4 = elevation == minimumItem
filterByBoolMask = List.FilterByBoolMask(list=all_elements_of_category, mask=eq_4)
plane_2 = Custom[Level.Plane](level=filterByBoolMask.in)  # package Clockwork for Dynamo 2.x; Retrieves the plane of a given level
pullOntoPlane = Curve.PullOntoPlane(curve=scopeIf_3, plane=plane_2)
ZAxis = Vector.ZAxis()
code_block_42 = CodeBlock { -3000; }
translate = Geometry.Translate(geometry=pullOntoPlane, direction=ZAxis, distance=code_block_42, lacing=Longest)
code_block_43 = CodeBlock { "Building Section (04_CH)"; }
byName_3 = Orchid.RevitProject.Views.ViewType.ByName(name=code_block_43)
code_block_44 = CodeBlock { 0.5; }
pointAtParameter_4 = Curve.PointAtParameter(curve=translate, param=code_block_44)
code_block_45 = CodeBlock { "Levels"; }
byName_4 = Category.ByName(name=code_block_45)
all_elements_of_category_2 = ElementsOfCategory(Category=byName_4)
elevation_2 = Level.Elevation(level=all_elements_of_category_2)
maximumItem = List.MaximumItem(list=elevation_2)
eq_5 = elevation_2 == maximumItem
filterByBoolMask_2 = List.FilterByBoolMask(list=all_elements_of_category_2, mask=eq_5)
plane_3 = Custom[Level.Plane](level=filterByBoolMask_2.in)
pullOntoPlane_2 = Curve.PullOntoPlane(curve=scopeIf_3, plane=plane_3)
ZAxis_2 = Vector.ZAxis()
code_block_46 = CodeBlock { 3000; }
translate_2 = Geometry.Translate(geometry=pullOntoPlane_2, direction=ZAxis_2, distance=code_block_46, lacing=Longest)
code_block_47 = CodeBlock { 0.5; }
pointAtParameter_5 = Curve.PointAtParameter(curve=translate_2, param=code_block_47)
distanceTo = Geometry.DistanceTo(geometry=pointAtParameter_4, other=pointAtParameter_5)
code_block_48 = CodeBlock(h=distanceTo)
# ---------- code_block_48.designscript (6 lines) ----------
//height
h[0];
//offset
300;
//depth
300;
# ----------------------------------------
byLine = Custom[ViewSection.ByLine](Curves=translate, ViewFamilyType=byName_3, ViewSectionHeight=code_block_48.out0, OffsetFromLine=code_block_48.out1, Depth=code_block_48.out2)  # package Data-Shapes; Create ViewSections in current document from DS Lines.
code_block_49 = CodeBlock(x=code_block_19.out1) { x[2]; }
setScale = View.SetScale(view=byLine, scale=code_block_49)
code_block_50 = CodeBlock()
# ---------- code_block_50.designscript (4 lines) ----------
[
"View Name",
"Title on Sheet"
];
# ----------------------------------------
code_block_51 = CodeBlock(x=code_block_19.out1) { x[0]; }
code_block_52 = CodeBlock { "Numeracion Columna"; }
getParameterValueByName_2 = Element.GetParameterValueByName(element=code_block_51, parameterName=code_block_52)
code_block_53 = CodeBlock(num=getParameterValueByName_2) { DSCore.List.Flatten(["CH_COLUMNA P"+num,"ELEV. PILAR P"+num],1); }
setParameterByName_3 = Element.SetParameterByName(element=setScale@L1, parameterName=code_block_50@L2, value=code_block_53@L2, lacing=Longest)
all = Orchid.RevitProject.Views.View.All()
code_block_54 = CodeBlock { "Subclasificacion"; }
getParameterValueByName_3 = Element.GetParameterValueByName(element=all, parameterName=code_block_54)
code_block_55 = CodeBlock { "04_CH"; }
eq_6 = getParameterValueByName_3 == code_block_55
filterByBoolMask_3 = List.FilterByBoolMask(list=all, mask=eq_6)
viewType = archilab.Revit.Views.Views.ViewType(view=filterByBoolMask_3.in)
code_block_56 = CodeBlock { "CeilingPlan"; }
eq_7 = viewType == code_block_56
filterByBoolMask_4 = List.FilterByBoolMask(list=filterByBoolMask_3.in, mask=eq_7)
code_block_57 = CodeBlock { "Structural Columns"; }
byName_5 = Category.ByName(name=code_block_57)
all_elements_of_category_3 = ElementsOfCategory(Category=byName_5)
code_block_58 = CodeBlock { "Numeracion Columna"; }
exists = Orchid.RevitProject.Parameters.Parameter.Exists(parameterName=code_block_58, element=all_elements_of_category_3)
filterByBoolMask_5 = List.FilterByBoolMask(list=all_elements_of_category_3, mask=exists)
code_block_59 = CodeBlock { "Numeracion Columna"; }
getParameterValueByName_4 = Element.GetParameterValueByName(element=filterByBoolMask_5.in, parameterName=code_block_59)
code_block_60 = CodeBlock(x=code_block_19.out1) { x[0]; }
code_block_61 = CodeBlock { "Numeracion Columna"; }
getParameterValueByName_5 = Element.GetParameterValueByName(element=code_block_60, parameterName=code_block_61)
code_block_62 = CodeBlock { null; }
replaceEmptyLists = Custom[List.ReplaceEmptyLists](seq=getParameterValueByName_5, Replacement=code_block_62)  # package Clockwork for Dynamo 2.x; Replaces all empty lists within a given list with a substitute
eq_8 = getParameterValueByName_4@L1 == replaceEmptyLists@L2  # lacing=Longest
anyTrue_2 = Orchid.Common.List.AnyTrue(list=eq_8@L2)
filterByBoolMask_6 = List.FilterByBoolMask(list=filterByBoolMask_5.in, mask=anyTrue_2)
fillpatterns = Custom[© FillPatterns]()  # package Crumple; Returns all fill patterns in a document.
code_block_63 = CodeBlock { "<Solid fill>"; }
eq_9 = fillpatterns.names == code_block_63
filterByBoolMask_7 = List.FilterByBoolMask(list=fillpatterns.elements, mask=eq_9)
firstItem = List.FirstItem(list=filterByBoolMask_7.in)
color_palette = ColorPalette({R: 46, G: 139, B: 87, A: 255})
create_overridegraphicsettings = Custom[Create OverrideGraphicSettings](SurfaceForegroundPattern=firstItem, SurfaceForegroundPatternColor=color_palette, SurfaceBackgroundPattern=firstItem, SurfaceBackgroundColor=color_palette, CutForegroundPattern=firstItem, CutForegroundPatternColor=color_palette, CutBackgroundPattern=firstItem, CutBackgroundPatternColor=color_palette)  # package Genius Loci; Create a OverrideGraphicSettings (All graphic inputs are optional). Unlike the OOTB OverrideGraphicSettings.ByProperties node, the Foreground and background patterns are available. Note : Prior to Revit 2019, the materials have only one surface pattern and one cut pattern.
view_setelementoverrides = Custom[View SetElementOverrides](view=filterByBoolMask_4.in@L1, elements=filterByBoolMask_6.in@L2, overrides=create_overridegraphicsettings@L1, lacing=Longest)  # package Genius Loci; Overrides element graphics settings in the given view. For use with the Create OverrideGraphicSettings node. Can also be used to hide or unhide elements.
