# Dynamo graph elevacionEje_script.dyn (Dynamo 2.3.2.15696)
# packages: Data-Shapes 2021.2.94, Orchid 200.4.0.7938, Clockwork for Dynamo 2.x 2.4.0, archi-lab.net 2022.210.2419, Genius Loci 2021.11.10, Crumple 2022.2.13, Rhythm 2020.7.25

hideElements = archilab.Revit.Views.Views.HideElements()  # unwired: view, elements
code_block = CodeBlock { "Elevación por Eje"; }
code_block_2 = CodeBlock()
# ---------- code_block_2.designscript (9 lines) ----------
//buttonText
"INICIAR";
//buttonCancel
"CANCELAR";
//maxHeight
850;
//width
440;
//label
# ----------------------------------------
code_block_3 = CodeBlock { "(Categoria MA)"; }
code_block_4 = CodeBlock { "Escala:"; }
code_block_5 = CodeBlock()
# ---------- code_block_5.designscript (6 lines) ----------
[
"1:50",
"1:75",
"1:100",
"1:125"
];
# ----------------------------------------
code_block_6 = CodeBlock { ":"; }
split = String.Split(str=code_block_5, separator0=code_block_6)
code_block_7 = CodeBlock { 1; }
getItemAtIndex = List.GetItemAtIndex(list=split@L2, index=code_block_7)
toNumber = String.ToNumber(str=getItemAtIndex)
code_block_8 = CodeBlock { 0; false; }
dropdown_data = Custom[DropDown Data](InputName=code_block_4, Keys=code_block_5, Values=toNumber, DefaultValueIndex=code_block_8.out0, Sorted_optional=code_block_8.out1)  # package Data-Shapes; Create data for DropDown input in UI.MultiInputForm ++ . Check out www.data-shapes.net for more infos.
code_block_9 = CodeBlock { "Grids"; }
byName = Category.ByName(name=code_block_9)
all_elements_of_category = ElementsOfCategory(Category=byName)
code_block_10 = CodeBlock(g=all_elements_of_category) { "ELEVACIÓN EJE "+Revit.Elements.Element.Name(g); }
code_block_11 = CodeBlock { "Building Section (02_MA)"; }
byName_2 = Orchid.RevitProject.Views.ViewType.ByName(name=code_block_11)
byType = Orchid.RevitProject.Views.View.ByType(viewType=byName_2)
code_block_12 = CodeBlock { "Subclasificacion"; }
getParameterValueByName = Element.GetParameterValueByName(element=byType, parameterName=code_block_12)
code_block_13 = CodeBlock { "02_MA"; }
eq = getParameterValueByName == code_block_13
filterByBoolMask = List.FilterByBoolMask(list=byType, mask=eq)
code_block_14 = CodeBlock { "Title on Sheet"; }
getParameterValueByName_2 = Element.GetParameterValueByName(element=filterByBoolMask.in, parameterName=code_block_14)
code_block_15 = CodeBlock { null; }
replaceEmptyLists = Custom[List.ReplaceEmptyLists](seq=getParameterValueByName_2, Replacement=code_block_15)  # package Clockwork for Dynamo 2.x; Replaces all empty lists within a given list with a substitute
eq_2 = code_block_10@L1 == replaceEmptyLists@L2  # lacing=Longest
anyTrue = Orchid.Common.List.AnyTrue(list=eq_2)
filterByBoolMask_2 = List.FilterByBoolMask(list=all_elements_of_category, mask=anyTrue)
code_block_16 = CodeBlock(g=filterByBoolMask_2.out) { "ELEVACIÓN EJE "+Revit.Elements.Element.Name(g); }
radiobuttons_data = Custom[RadioButtons Data](Keys=code_block_16, Values=filterByBoolMask_2.out)  # package Data-Shapes; Create radio buttons input for UI.MultipleInputForm ++ .
list_create = List.Create(item0=dropdown_data, item1=radiobuttons_data)
inputgroup_data = Custom[InputGroup Data](GroupTitle=code_block_3, Inputs=list_create)  # package Data-Shapes; Creates a group of inputs for UI.MultipleInputForm ++ . Check out www.data-shapes.net for more infos !
boolean = BoolSelector(true)
multipleinputform = Custom[MultipleInputForm ++](Description_optional=code_block, ButtonText_optional=code_block_2.out0, Inputs=inputgroup_data, Toggle=boolean, CancelButtonText_optional=code_block_2.out1, MaxHeight_optional=code_block_2.out2, Width_optional=code_block_2.out3)  # package Data-Shapes; Create a form with multiple inputs. see www.data-shapes.net for tutorials and infos!
code_block_17 = CodeBlock(x=multipleinputform.User_Inputs)
# ---------- code_block_17.designscript (13 lines) ----------
x;

[Imperative]
{
	if(x == null)
	{
		return = [[],[]];
	}
	else
	{
		return = x;
	}
};
# ----------------------------------------
code_block_18 = CodeBlock(l=code_block_17.out1) { l[1]; }
curve = Grid.Curve(grid=code_block_18)
direction = Line.Direction(line=curve)
normalized = Vector.Normalized(vector=direction)
code_block_19 = CodeBlock(p=normalized) { p.X; }
code_block_20 = CodeBlock { 2; }
round = Math.Round(number=code_block_19, digits=code_block_20)
code_block_21 = CodeBlock { 0; }
le = round <= code_block_21
reverse = Curve.Reverse(curve=curve)
scopeIf = Custom[ScopeIf+](test=le, True=reverse, False=curve, lacing=Shortest)  # package Clockwork for Dynamo 2.x; A (hopefully) more robust implementation of ScopeIf. Tests a single boolean and returns a value accordingly.
code_block_22 = CodeBlock(x=scopeIf) { x; }
direction_2 = Line.Direction(line=code_block_22)
code_block_23 = CodeBlock(x=direction_2) { x.X; }
code_block_24 = CodeBlock { 0; }
ge = code_block_23 >= code_block_24
reverse_2 = Curve.Reverse(curve=code_block_22)
scopeIf_2 = Custom[ScopeIf+](test=ge, True=reverse_2, False=code_block_22, lacing=Shortest)
direction_3 = Line.Direction(line=scopeIf_2)
normalized_2 = Vector.Normalized(vector=direction_3)
code_block_25 = CodeBlock(x=normalized_2) { x.X; }
code_block_26 = CodeBlock { 0; }
eq_3 = code_block_25 == code_block_26
code_block_27 = CodeBlock(x=normalized_2) { x.Y; }
code_block_28 = CodeBlock { 0; }
gt = code_block_27 > code_block_28
and_ = eq_3 && gt
reverse_3 = Curve.Reverse(curve=scopeIf_2)
scopeIf_3 = Custom[ScopeIf+](test=and_, True=reverse_3, False=scopeIf_2, lacing=Shortest)
code_block_29 = CodeBlock { "Levels"; }
byName_3 = Category.ByName(name=code_block_29)
all_elements_of_category_2 = ElementsOfCategory(Category=byName_3)
elevation = Level.Elevation(level=all_elements_of_category_2)
minimumItem = List.MinimumItem(list=elevation)
eq_4 = elevation == minimumItem
filterByBoolMask_3 = List.FilterByBoolMask(list=all_elements_of_category_2, mask=eq_4)
plane = Custom[Level.Plane](level=filterByBoolMask_3.in)  # package Clockwork for Dynamo 2.x; Retrieves the plane of a given level
pullOntoPlane = Curve.PullOntoPlane(curve=scopeIf_3, plane=plane, lacing=Longest)
ZAxis = Vector.ZAxis()
code_block_30 = CodeBlock { -3000; }
translate = Geometry.Translate(geometry=pullOntoPlane, direction=ZAxis, distance=code_block_30, lacing=Longest)
code_block_31 = CodeBlock { "Building Section (02_MA)"; }
byName_4 = Orchid.RevitProject.Views.ViewType.ByName(name=code_block_31)
code_block_32 = CodeBlock { 0.5; }
pointAtParameter = Curve.PointAtParameter(curve=translate, param=code_block_32)
code_block_33 = CodeBlock { "Levels"; }
byName_5 = Category.ByName(name=code_block_33)
all_elements_of_category_3 = ElementsOfCategory(Category=byName_5)
elevation_2 = Level.Elevation(level=all_elements_of_category_3)
maximumItem = List.MaximumItem(list=elevation_2)
eq_5 = elevation_2 == maximumItem
filterByBoolMask_4 = List.FilterByBoolMask(list=all_elements_of_category_3, mask=eq_5)
plane_2 = Custom[Level.Plane](level=filterByBoolMask_4.in)
pullOntoPlane_2 = Curve.PullOntoPlane(curve=scopeIf_3, plane=plane_2, lacing=Longest)
ZAxis_2 = Vector.ZAxis()
code_block_34 = CodeBlock { 3000; }
translate_2 = Geometry.Translate(geometry=pullOntoPlane_2, direction=ZAxis_2, distance=code_block_34, lacing=Longest)
code_block_35 = CodeBlock { 0.5; }
pointAtParameter_2 = Curve.PointAtParameter(curve=translate_2, param=code_block_35)
distanceTo = Geometry.DistanceTo(geometry=pointAtParameter, other=pointAtParameter_2)
code_block_36 = CodeBlock { null; }
replaceEmptyLists_2 = Custom[List.ReplaceEmptyLists](seq=distanceTo, Replacement=code_block_36)
code_block_37 = CodeBlock(x=replaceEmptyLists_2)
# ---------- code_block_37.designscript (12 lines) ----------
x;
[Imperative]
{
	if(x == null)
	{
		return = [[]];
	}
	else
	{
		return = x;
	}
};
# ----------------------------------------
code_block_38 = CodeBlock(h=code_block_37.out1)
# ---------- code_block_38.designscript (6 lines) ----------
//height
h[0];
//offset
300;
//depth
300;
# ----------------------------------------
byLine = Custom[ViewSection.ByLine](Curves=translate, ViewFamilyType=byName_4, ViewSectionHeight=code_block_38.out0, OffsetFromLine=code_block_38.out1, Depth=code_block_38.out2)  # package Data-Shapes; Create ViewSections in current document from DS Lines.
code_block_39 = CodeBlock(g=code_block_18) { "View Name"; "MA_ELEVACION EJE "+Revit.Elements.Element.Name(g); }
setParameterByName = Element.SetParameterByName(element=byLine, parameterName=code_block_39.out0, value=code_block_39.out1, lacing=Longest)
code_block_40 = CodeBlock(g=code_block_18) { "Title on Sheet"; "ELEVACIÓN EJE "+Revit.Elements.Element.Name(g); }
setParameterByName_2 = Element.SetParameterByName(element=setParameterByName, parameterName=code_block_40.out0, value=code_block_40.out1, lacing=Longest)
code_block_41 = CodeBlock(l=code_block_17.out1) { l[0]; }
setScale = View.SetScale(view=setParameterByName_2, scale=code_block_41, lacing=Longest)
code_block_42 = CodeBlock()
# ---------- code_block_42.designscript (5 lines) ----------
[
"Crop View",
"Crop Region Visible"
];
[1,0];
# ----------------------------------------
setParameterByName_3 = Element.SetParameterByName(element=setScale@L1, parameterName=code_block_42.out0@L2, value=code_block_42.out1@L2, lacing=Longest)
flatten = List.Flatten(list=setParameterByName_3)
uniqueItems = List.UniqueItems(list=flatten)
all_elements_in_view_s = Custom[All Elements In View(s)](Views=uniqueItems)  # package Data-Shapes; Retrieves all visible element in a view or a set of views
code_block_43 = CodeBlock { "View Name"; }
exists = Orchid.RevitProject.Parameters.Parameter.Exists(parameterName=code_block_43, element=all_elements_in_view_s)
filterByBoolMask_5 = List.FilterByBoolMask(list=all_elements_in_view_s, mask=exists)
code_block_44 = CodeBlock { "Type"; }
getParameterValueByName_3 = Element.GetParameterValueByName(element=filterByBoolMask_5.in, parameterName=code_block_44)
name = Orchid.RevitProject.Elements.ElementType.Name(elementType=getParameterValueByName_3)
code_block_45 = CodeBlock { "Building Section (02_MA)"; }
eq_6 = name == code_block_45
filterByBoolMask_6 = List.FilterByBoolMask(list=filterByBoolMask_5.in, mask=eq_6)
function_apply = ApplyFunction(func=hideElements, arg1=uniqueItems, arg2=filterByBoolMask_6.in)
code_block_46 = CodeBlock { null; }
replaceEmptyLists_3 = Custom[List.ReplaceEmptyLists](seq=function_apply, Replacement=code_block_46)
end = Revit.Transaction.Transaction.End(input=replaceEmptyLists_3)
code_block_47 = CodeBlock(x=end)
# ---------- code_block_47.designscript (13 lines) ----------
x;

[Imperative]
{
	if(x == null)
	{
		return = [];
	}
	else
	{
		return = "Section";
	}
};
# ----------------------------------------
getByType = archilab.Revit.Views.Views.GetByType(viewType=code_block_47.out1)
all_elements_in_view_s_2 = Custom[All Elements In View(s)](Views=getByType)
code_block_48 = CodeBlock { "View Name"; }
exists_2 = Orchid.RevitProject.Parameters.Parameter.Exists(parameterName=code_block_48, element=all_elements_in_view_s_2)
filterByBoolMask_7 = List.FilterByBoolMask(list=all_elements_in_view_s_2, mask=exists_2)
hideElements_2 = archilab.Revit.Views.Views.HideElements(view=getByType, elements=filterByBoolMask_7.in)
end_2 = Revit.Transaction.Transaction.End(input=uniqueItems)
flatten_2 = List.Flatten(list=end_2)
uniqueItems_2 = List.UniqueItems(list=flatten_2)
code_block_49 = CodeBlock(x=uniqueItems_2)
# ---------- code_block_49.designscript (12 lines) ----------
x;
[Imperative]
{
	if(x == null)
	{
		return = [];
	}
	else
	{
		return = x[0];
	}
};
# ----------------------------------------
code_block_50 = CodeBlock(x=code_block_49.out1) { x; }

# group: Etiqueta Vigas Hormigon
activeView = Orchid.RevitProject.Common.Document.ActiveView()
code_block_51 = CodeBlock(x=code_block_50) { x; }
code_block_52 = CodeBlock { null; }
replaceEmptyLists_4 = Custom[List.ReplaceEmptyLists](seq=code_block_51, Replacement=code_block_52)
code_block_53 = CodeBlock(x=replaceEmptyLists_4)  # same code as code_block_17
code_block_54 = CodeBlock(x=code_block_53.out1) { x; }
code_block_55 = CodeBlock { "Structural Framing"; }
byName_6 = Category.ByName(name=code_block_55)
all_elements_of_category_in_view = ElementsOfCategoryInView(Category=byName_6, View=code_block_54)
familyName = Orchid.RevitProject.Elements.Element.FamilyName(element=all_elements_of_category_in_view)
code_block_56 = CodeBlock()
# ---------- code_block_56.designscript (6 lines) ----------
[
"EST_M_STRUCTURAL FRAMING_VIGA INVERTIDA",
"EST_M_STRUCTURAL FRAMING_VIGA SEMI INVERTIDA",
"EST_M_STRUCTURAL FRAMING_VIGA TRADICIONAL",
"EST_M_STRUCTURAL FRAMING_VIGA FUNDACION"
];
# ----------------------------------------
eq_7 = familyName@L1 == code_block_56
anyTrue_2 = Orchid.Common.List.AnyTrue(list=eq_7)
filterByBoolMask_8 = List.FilterByBoolMask(list=all_elements_of_category_in_view, mask=anyTrue_2)
location = Custom[Element.Location+](element=filterByBoolMask_8.in)  # package Clockwork for Dynamo 2.x; Returns the location of an element as point, curve or curve loop, along with some booleans to help filtering the results. Unlike the OOTB Element.GetLocation node, it also retunrs sketch lines of sketch-based elements like floor slabs as well as the element's rotation property.
code_block_57 = CodeBlock(x=location.curves)
# ---------- code_block_57.designscript (12 lines) ----------
x;
[Imperative]
{
	if(x == null)
	{
		return = [];
	}
	else
	{
		return = x;
	}
};
# ----------------------------------------
direction_4 = Line.Direction(line=code_block_57.out1)
code_block_58 = CodeBlock(x=code_block_53.out1) { x; }
plane_3 = Custom[View.Plane](view=code_block_58)  # package Clockwork for Dynamo 2.x; Retrieves the plane of a given view
isParallelToPlane = Custom[Vector.IsParallelToPlane](vector=direction_4, plane=plane_3)  # package Clockwork for Dynamo 2.x; Checks if a given vector is parallel to a given plane
filterByBoolMask_9 = List.FilterByBoolMask(list=filterByBoolMask_8.in, mask=isParallelToPlane)
element_taggedstatus = Custom[Element TaggedStatus](element=filterByBoolMask_9.in)  # package Genius Loci; Identify the tagged and untagged elements. Please note : This doesn't work with areas and spaces.
elementcentroid = Custom[© ElementCentroid](element=element_taggedstatus.NotTagged)  # package Crumple; Returns the centroid of the element's axis-aligned bounding box.
location_2 = Custom[Element.Location+](element=element_taggedstatus.NotTagged)
code_block_59 = CodeBlock(x=location_2.curves)  # same code as code_block_57
code_block_60 = CodeBlock { 0.5; }
planeAtParameter = Curve.PlaneAtParameter(curve=code_block_59.out1, param=code_block_60)
code_block_61 = CodeBlock { 0.5; }
pointAtParameter_3 = Curve.PointAtParameter(curve=code_block_59.out1, param=code_block_61)
plane_4 = Custom[View.Plane](view=code_block_58)
normal = Plane.Normal(plane=plane_4)
code_block_62 = CodeBlock { 90; }
rotate = Geometry.Rotate(geometry=planeAtParameter, origin=pointAtParameter_3, axis=normal, degrees=code_block_62)
normal_2 = Plane.Normal(plane=rotate)
code_block_63 = CodeBlock(z=normal_2) { z.Z; }
code_block_64 = CodeBlock { 0; }
gt_2 = code_block_63 > code_block_64
code_block_65 = CodeBlock { -1; }
ne = code_block_63 != code_block_65
and_2 = gt_2 && ne
reverse_4 = Vector.Reverse(vector=normal_2)
scopeIf_4 = Custom[ScopeIf+](test=and_2, True=normal_2, False=reverse_4, lacing=Shortest)
code_block_66 = CodeBlock(x=element_taggedstatus.NotTagged) { Revit.Elements.Element.GetParameterValueByName(Revit.Elements.Element.GetParameterValueByName(x,"Type"),"Height")/2; }
translate_3 = Geometry.Translate(geometry=elementcentroid, direction=scopeIf_4, distance=code_block_66)
list_create_2 = List.Create(item0=elementcentroid, item1=translate_3)
transpose = List.Transpose(lists=list_create_2)
byElementAndLocation = Tag.ByElementAndLocation(view=code_block_54@L1, element=element_taggedstatus.NotTagged@L1, location=transpose@L2, lacing=Longest)
transpose_2 = List.Transpose(lists=byElementAndLocation)
code_block_67 = CodeBlock { null; }
replaceEmptyLists_5 = Custom[List.ReplaceEmptyLists](seq=transpose_2, Replacement=code_block_67)
code_block_68 = CodeBlock(x=replaceEmptyLists_5)
# ---------- code_block_68.designscript (12 lines) ----------
x;
[Imperative]
{
	if(x == null)
	{
		return = [[],[]];
	}
	else
	{
		return = x;
	}
};
# ----------------------------------------
code_block_69 = CodeBlock(x=code_block_68.out1) { x[1]; }
code_block_70 = CodeBlock { "Type"; }
code_block_71 = CodeBlock { "EST_A_STRUCTURAL FRAMING TAG_ELEVACION"; }
byName_7 = Orchid.RevitProject.Elements.Family.ByName(name=code_block_71)
code_block_72 = CodeBlock { "Tag Viga"; }
byFamilyAndName = FamilyType.ByFamilyAndName(family=byName_7, name=code_block_72)
setParameterByName_4 = Element.SetParameterByName(element=code_block_69, parameterName=code_block_70, value=byFamilyAndName)
code_block_73 = CodeBlock(x=code_block_68.out1) { x[0]; }
code_block_74 = CodeBlock { "Type"; }
code_block_75 = CodeBlock { "EST_A_STRUCTURAL FRAMING TAG_ELEVACION_ESTRIBO Y LATERAL"; }
byName_8 = Orchid.RevitProject.Elements.Family.ByName(name=code_block_75)
code_block_76 = CodeBlock { "Estribo Simple y Laterales"; }
byFamilyAndName_2 = FamilyType.ByFamilyAndName(family=byName_8, name=code_block_76)
setParameterByName_5 = Element.SetParameterByName(element=code_block_73, parameterName=code_block_74, value=byFamilyAndName_2)

code_block_77 = CodeBlock { null; }
replaceEmptyLists_6 = Custom[List.ReplaceEmptyLists](seq=code_block_49.out1, Replacement=code_block_77)
code_block_78 = CodeBlock(x=replaceEmptyLists_6)
# ---------- code_block_78.designscript (13 lines) ----------
x;

[Imperative]
{
	if(x == null)
	{
		return = [];
	}
	else
	{
		return = x;
	}
};
# ----------------------------------------

# group: Etiqueta Muros
code_block_79 = CodeBlock(x=code_block_78.out1) { x; }
code_block_80 = CodeBlock(x=code_block_79) { x; }
code_block_81 = CodeBlock { "Walls"; }
byName_9 = Category.ByName(name=code_block_81)
all_elements_of_category_in_view_2 = ElementsOfCategoryInView(Category=byName_9, View=code_block_80)
wallType = archilab.Revit.Elements.Walls.WallType(wall=all_elements_of_category_in_view_2)
kind = Orchid.RevitProject.Elements.WallType.Kind(wallType=wallType)
code_block_82 = CodeBlock { "Basic"; }
eq_8 = kind == code_block_82
filterByBoolMask_10 = List.FilterByBoolMask(list=all_elements_of_category_in_view_2, mask=eq_8)
name_2 = Material.Name()  # unwired: material
getMaterials = Element.GetMaterials(element=filterByBoolMask_10.in)
flatten_3 = List.Flatten(list=getMaterials)
function_apply_2 = ApplyFunction(func=name_2, arg1=flatten_3)
code_block_83 = CodeBlock { "Concrete, Cast-in-Place gray"; }
eq_9 = function_apply_2 == code_block_83
filterByBoolMask_11 = List.FilterByBoolMask(list=filterByBoolMask_10.in, mask=eq_9)
location_3 = Custom[Element.Location+](element=filterByBoolMask_11.in)
code_block_84 = CodeBlock(x=location_3.curves)  # same code as code_block_57
direction_5 = Line.Direction(line=code_block_84.out1)
code_block_85 = CodeBlock(x=code_block_79) { x; }
plane_5 = Custom[View.Plane](view=code_block_85)
isParallelToPlane_2 = Custom[Vector.IsParallelToPlane](vector=direction_5, plane=plane_5)
filterByBoolMask_12 = List.FilterByBoolMask(list=filterByBoolMask_11.in, mask=isParallelToPlane_2)
element_taggedstatus_2 = Custom[Element TaggedStatus](element=filterByBoolMask_12.in)
elementcentroid_2 = Custom[© ElementCentroid](element=element_taggedstatus_2.NotTagged)
byElementAndLocation_2 = Tag.ByElementAndLocation(view=code_block_80, element=element_taggedstatus_2.NotTagged, location=elementcentroid_2)
code_block_86 = CodeBlock { "Type"; }
code_block_87 = CodeBlock { "EST_A_WALL TAG_ELEVACION_MHA"; }
byName_10 = Orchid.RevitProject.Elements.Family.ByName(name=code_block_87)
code_block_88 = CodeBlock { "Doble Malla"; }
byFamilyAndName_3 = FamilyType.ByFamilyAndName(family=byName_10, name=code_block_88)
setParameterByName_6 = Element.SetParameterByName(element=byElementAndLocation_2, parameterName=code_block_86, value=byFamilyAndName_3)

# group: Columnas Metalicas Rectangulares
code_block_89 = CodeBlock(x=code_block_78.out1) { x; }
code_block_90 = CodeBlock(x=code_block_89) { x; }
code_block_91 = CodeBlock { "Structural Columns"; }
byName_11 = Category.ByName(name=code_block_91)
all_elements_of_category_in_view_3 = ElementsOfCategoryInView(Category=byName_11, View=code_block_90)
familyName_2 = Orchid.RevitProject.Elements.Element.FamilyName(element=all_elements_of_category_in_view_3)
code_block_92 = CodeBlock()
# ---------- code_block_92.designscript (11 lines) ----------
[
"EST_M_STRUCTURAL COLUMN_SOLDADA_IN",
"EST_M_STRUCTURAL COLUMN_LAMINADA_L",
"EST_M_STRUCTURAL COLUMN_PLEGADA_C",
"EST_M_STRUCTURAL COLUMN_PLEGADA_CA",
"EST_M_STRUCTURAL COLUMN_PLEGADA_HSS",
"EST_M_STRUCTURAL COLUMN_PLEGADA_IC",
"EST_M_STRUCTURAL COLUMN_PLEGADA_L",
"EST_M_STRUCTURAL COLUMN_SOLDADA_HN",
"EST_M_STRUCTURAL COLUMN_SOLDADA_T"
];
# ----------------------------------------
eq_10 = familyName_2@L1 == code_block_92
anyTrue_3 = Orchid.Common.List.AnyTrue(list=eq_10)
filterByBoolMask_13 = List.FilterByBoolMask(list=all_elements_of_category_in_view_3, mask=anyTrue_3)
name_3 = Material.Name()  # unwired: material
getMaterials_2 = Element.GetMaterials(element=filterByBoolMask_13.in)
flatten_4 = List.Flatten(list=getMaterials_2)
function_apply_3 = ApplyFunction(func=name_3, arg1=flatten_4)
code_block_93 = CodeBlock { "Steel"; }
eq_11 = function_apply_3 == code_block_93
filterByBoolMask_14 = List.FilterByBoolMask(list=filterByBoolMask_13.in, mask=eq_11)
element_taggedstatus_3 = Custom[Element TaggedStatus](element=filterByBoolMask_14.in)
code_block_94 = CodeBlock { "Column Style"; 1; }
setParameterByName_7 = Element.SetParameterByName(element=element_taggedstatus_3.NotTagged, parameterName=code_block_94.out0, value=code_block_94.out1)
location_4 = Custom[Element.Location+](element=setParameterByName_7)
code_block_95 = CodeBlock(x=location_4.curves)  # same code as code_block_57
await_ = Orchid.Common.DataStream.Await(pass=setParameterByName_7, waitFor=code_block_95.out1)
elementcentroid_3 = Custom[© ElementCentroid](element=await_)
code_block_96 = CodeBlock { 0.5; }
planeAtParameter_2 = Curve.PlaneAtParameter(curve=code_block_95.out1, param=code_block_96)
code_block_97 = CodeBlock { 0.5; }
pointAtParameter_4 = Curve.PointAtParameter(curve=code_block_95.out1, param=code_block_97)
code_block_98 = CodeBlock(x=code_block_89) { x; }
plane_6 = Custom[View.Plane](view=code_block_98)
normal_3 = Plane.Normal(plane=plane_6)
code_block_99 = CodeBlock { 90; }
rotate_2 = Geometry.Rotate(geometry=planeAtParameter_2, origin=pointAtParameter_4, axis=normal_3, degrees=code_block_99)
normal_4 = Plane.Normal(plane=rotate_2)
code_block_100 = CodeBlock(z=normal_4) { z.Z; }
code_block_101 = CodeBlock { 0; }
gt_3 = code_block_100 > code_block_101
code_block_102 = CodeBlock { -1; }
ne_2 = code_block_100 != code_block_102
and_3 = gt_3 && ne_2
reverse_5 = Vector.Reverse(vector=normal_4)
scopeIf_5 = Custom[ScopeIf+](test=and_3, True=normal_4, False=reverse_5, lacing=Shortest)
code_block_103 = CodeBlock(x=await_) { Revit.Elements.Element.GetParameterValueByName(Revit.Elements.Element.GetParameterValueByName(x,"Type"),"Width")/2; }
translate_4 = Geometry.Translate(geometry=elementcentroid_3, direction=scopeIf_5, distance=code_block_103)
code_block_104 = CodeBlock()
# ---------- code_block_104.designscript (2 lines) ----------
//horizontal
false;
# ----------------------------------------
byElementAndLocation_3 = Tag.ByElementAndLocation(view=code_block_90, element=await_, location=translate_4, horizontal=code_block_104)
code_block_105 = CodeBlock { "Type"; }
code_block_106 = CodeBlock { "EST_A_STRUCTURAL COLUMN TAG_ELEVACION_DIMENSIONES"; }
byName_12 = Orchid.RevitProject.Elements.Family.ByName(name=code_block_106)
code_block_107 = CodeBlock { "Pilar Hormigon"; }
byFamilyAndName_4 = FamilyType.ByFamilyAndName(family=byName_12, name=code_block_107)
setParameterByName_8 = Element.SetParameterByName(element=byElementAndLocation_3, parameterName=code_block_105, value=byFamilyAndName_4)
code_block_108 = CodeBlock { "Column Style"; 0; }
setParameterByName_9 = Element.SetParameterByName(element=await_, parameterName=code_block_108.out0, value=code_block_108.out1)

# group: Etiqueta Columna Rectangular hormigon
code_block_109 = CodeBlock { "Structural Columns"; }
byName_13 = Category.ByName(name=code_block_109)
code_block_110 = CodeBlock(x=code_block_78.out1) { x; }
code_block_111 = CodeBlock(x=code_block_110) { x; }
all_elements_of_category_in_view_4 = ElementsOfCategoryInView(Category=byName_13, View=code_block_111)
familyName_3 = Orchid.RevitProject.Elements.Element.FamilyName(element=all_elements_of_category_in_view_4)
code_block_112 = CodeBlock { "EST_M_STRUCTURAL COLUMN_RECTANGULAR"; }
eq_12 = familyName_3 == code_block_112
filterByBoolMask_15 = List.FilterByBoolMask(list=all_elements_of_category_in_view_4, mask=eq_12)
name_4 = Material.Name()  # unwired: material
getMaterials_3 = Element.GetMaterials(element=filterByBoolMask_15.in)
flatten_5 = List.Flatten(list=getMaterials_3)
function_apply_4 = ApplyFunction(func=name_4, arg1=flatten_5)
code_block_113 = CodeBlock { "Concrete, Cast-in-Place gray"; }
eq_13 = function_apply_4 == code_block_113
filterByBoolMask_16 = List.FilterByBoolMask(list=filterByBoolMask_15.in, mask=eq_13)
element_taggedstatus_4 = Custom[Element TaggedStatus](element=filterByBoolMask_16.in)
code_block_114 = CodeBlock { "Column Style"; 1; }
setParameterByName_10 = Element.SetParameterByName(element=element_taggedstatus_4.NotTagged, parameterName=code_block_114.out0, value=code_block_114.out1)
location_5 = Custom[Element.Location+](element=setParameterByName_10)
code_block_115 = CodeBlock(x=location_5.curves)  # same code as code_block_57
await_2 = Orchid.Common.DataStream.Await(pass=setParameterByName_10, waitFor=code_block_115.out1)
code_block_116 = CodeBlock { "Column Style"; 0; }
setParameterByName_11 = Element.SetParameterByName(element=await_2, parameterName=code_block_116.out0, value=code_block_116.out1)
elementcentroid_4 = Custom[© ElementCentroid](element=await_2)
code_block_117 = CodeBlock { 0.5; }
planeAtParameter_3 = Curve.PlaneAtParameter(curve=code_block_115.out1, param=code_block_117)
code_block_118 = CodeBlock { 0.5; }
pointAtParameter_5 = Curve.PointAtParameter(curve=code_block_115.out1, param=code_block_118)
code_block_119 = CodeBlock(x=code_block_110) { x; }
plane_7 = Custom[View.Plane](view=code_block_119)
normal_5 = Plane.Normal(plane=plane_7)
code_block_120 = CodeBlock { 90; }
rotate_3 = Geometry.Rotate(geometry=planeAtParameter_3, origin=pointAtParameter_5, axis=normal_5, degrees=code_block_120)
normal_6 = Plane.Normal(plane=rotate_3)
code_block_121 = CodeBlock(z=normal_6) { z.Z; }
code_block_122 = CodeBlock { 0; }
gt_4 = code_block_121 > code_block_122
code_block_123 = CodeBlock { -1; }
ne_3 = code_block_121 != code_block_123
and_4 = gt_4 && ne_3
reverse_6 = Vector.Reverse(vector=normal_6)
scopeIf_6 = Custom[ScopeIf+](test=and_4, True=normal_6, False=reverse_6, lacing=Shortest)
code_block_124 = CodeBlock(x=await_2) { Revit.Elements.Element.GetParameterValueByName(Revit.Elements.Element.GetParameterValueByName(x,"Type"),"Width")/2; }
translate_5 = Geometry.Translate(geometry=elementcentroid_4, direction=scopeIf_6, distance=code_block_124)
code_block_125 = CodeBlock()  # same code as code_block_104
byElementAndLocation_4 = Tag.ByElementAndLocation(view=code_block_111, element=await_2, location=translate_5, horizontal=code_block_125)
code_block_126 = CodeBlock { "Type"; }
code_block_127 = CodeBlock { "EST_A_STRUCTURAL COLUMN TAG_ELEVACION_DIMENSIONES"; }
byName_14 = Orchid.RevitProject.Elements.Family.ByName(name=code_block_127)
code_block_128 = CodeBlock { "Pilar Hormigon"; }
byFamilyAndName_5 = FamilyType.ByFamilyAndName(family=byName_14, name=code_block_128)
setParameterByName_12 = Element.SetParameterByName(element=byElementAndLocation_4, parameterName=code_block_126, value=byFamilyAndName_5)

# group: Etiqueta Columna Circular Hormigon
code_block_129 = CodeBlock { "Structural Columns"; }
byName_15 = Category.ByName(name=code_block_129)
code_block_130 = CodeBlock(x=code_block_78.out1) { x; }
code_block_131 = CodeBlock(x=code_block_130) { x; }
all_elements_of_category_in_view_5 = ElementsOfCategoryInView(Category=byName_15, View=code_block_131)
familyName_4 = Orchid.RevitProject.Elements.Element.FamilyName(element=all_elements_of_category_in_view_5)
code_block_132 = CodeBlock { "EST_M_STRUCTURAL COLUMN_CIRCULAR"; }
eq_14 = familyName_4 == code_block_132
filterByBoolMask_17 = List.FilterByBoolMask(list=all_elements_of_category_in_view_5, mask=eq_14)
name_5 = Material.Name()  # unwired: material
getMaterials_4 = Element.GetMaterials(element=filterByBoolMask_17.in)
flatten_6 = List.Flatten(list=getMaterials_4)
function_apply_5 = ApplyFunction(func=name_5, arg1=flatten_6)
code_block_133 = CodeBlock { "Concrete, Cast-in-Place gray"; }
eq_15 = function_apply_5 == code_block_133
filterByBoolMask_18 = List.FilterByBoolMask(list=filterByBoolMask_17.in, mask=eq_15)
element_taggedstatus_5 = Custom[Element TaggedStatus](element=filterByBoolMask_18.in)
code_block_134 = CodeBlock { "Column Style"; 1; }
setParameterByName_13 = Element.SetParameterByName(element=element_taggedstatus_5.NotTagged, parameterName=code_block_134.out0, value=code_block_134.out1)
location_6 = Custom[Element.Location+](element=setParameterByName_13)
code_block_135 = CodeBlock(x=location_6.curves)  # same code as code_block_57
await_3 = Orchid.Common.DataStream.Await(pass=setParameterByName_13, waitFor=code_block_135.out1)
code_block_136 = CodeBlock { "Column Style"; 0; }
setParameterByName_14 = Element.SetParameterByName(element=await_3, parameterName=code_block_136.out0, value=code_block_136.out1)
elementcentroid_5 = Custom[© ElementCentroid](element=await_3)
code_block_137 = CodeBlock { 0.5; }
planeAtParameter_4 = Curve.PlaneAtParameter(curve=code_block_135.out1, param=code_block_137)
code_block_138 = CodeBlock { 0.5; }
pointAtParameter_6 = Curve.PointAtParameter(curve=code_block_135.out1, param=code_block_138)
code_block_139 = CodeBlock { 90; }
code_block_140 = CodeBlock { 0; }
code_block_141 = CodeBlock { -1; }
code_block_142 = CodeBlock(x=await_3) { Revit.Elements.Element.GetParameterValueByName(Revit.Elements.Element.GetParameterValueByName(x,"Type"),"Diameter")/2; }
code_block_143 = CodeBlock()  # same code as code_block_104
code_block_144 = CodeBlock { "Type"; }
code_block_145 = CodeBlock { "EST_A_STRUCTURAL COLUMN TAG_ELEVACION_DIMENSIONES"; }
byName_16 = Orchid.RevitProject.Elements.Family.ByName(name=code_block_145)
code_block_146 = CodeBlock { "Pilar Hormigon"; }
byFamilyAndName_6 = FamilyType.ByFamilyAndName(family=byName_16, name=code_block_146)

code_block_147 = CodeBlock(x=code_block_130) { x; }

# group (continued): Etiqueta Columna Circular Hormigon
plane_8 = Custom[View.Plane](view=code_block_147)
normal_7 = Plane.Normal(plane=plane_8)
rotate_4 = Geometry.Rotate(geometry=planeAtParameter_4, origin=pointAtParameter_6, axis=normal_7, degrees=code_block_139)
normal_8 = Plane.Normal(plane=rotate_4)
code_block_148 = CodeBlock(z=normal_8) { z.Z; }
gt_5 = code_block_148 > code_block_140
ne_4 = code_block_148 != code_block_141
and_5 = gt_5 && ne_4
reverse_7 = Vector.Reverse(vector=normal_8)
scopeIf_7 = Custom[ScopeIf+](test=and_5, True=normal_8, False=reverse_7, lacing=Shortest)
translate_6 = Geometry.Translate(geometry=elementcentroid_5, direction=scopeIf_7, distance=code_block_142)
byElementAndLocation_5 = Tag.ByElementAndLocation(view=code_block_131, element=await_3, location=translate_6, horizontal=code_block_143)
setParameterByName_15 = Element.SetParameterByName(element=byElementAndLocation_5, parameterName=code_block_144, value=byFamilyAndName_6)

# group: Etiqueta Vigas Metalicas
code_block_149 = CodeBlock { "Structural Framing"; }
byName_17 = Category.ByName(name=code_block_149)
code_block_150 = CodeBlock(x=code_block_78.out1) { x; }
all_elements_of_category_in_view_6 = ElementsOfCategoryInView(Category=byName_17, View=code_block_150)
familyName_5 = Orchid.RevitProject.Elements.Element.FamilyName(element=all_elements_of_category_in_view_6)
code_block_151 = CodeBlock()
# ---------- code_block_151.designscript (12 lines) ----------
[
"EST_M_STRUCTURAL FRAMING_VIGA LAMINADA_L",
"EST_M_STRUCTURAL FRAMING_VIGA OHM",
"EST_M_STRUCTURAL FRAMING_VIGA PLEGADA_C",
"EST_M_STRUCTURAL FRAMING_VIGA PLEGADA_CA",
"EST_M_STRUCTURAL FRAMING_VIGA PLEGADA_HSS",
"EST_M_STRUCTURAL FRAMING_VIGA PLEGADA_HSSE",
"EST_M_STRUCTURAL FRAMING_VIGA PLEGADA_L",
"EST_M_STRUCTURAL FRAMING_VIGA SOLDADA_HN",
"EST_M_STRUCTURAL FRAMING_VIGA SOLDADA_IN",
"EST_M_STRUCTURAL FRAMING_VIGA SOLDADA_T"
];
# ----------------------------------------
eq_16 = familyName_5@L1 == code_block_151
anyTrue_4 = Orchid.Common.List.AnyTrue(list=eq_16)
filterByBoolMask_19 = List.FilterByBoolMask(list=all_elements_of_category_in_view_6, mask=anyTrue_4)
name_6 = Material.Name()  # unwired: material
getMaterials_5 = Element.GetMaterials(element=filterByBoolMask_19.in)
flatten_7 = List.Flatten(list=getMaterials_5)
function_apply_6 = ApplyFunction(func=name_6, arg1=flatten_7)
code_block_152 = CodeBlock { "Concrete, Cast-in-Place gray"; }
eq_17 = function_apply_6 == code_block_152
filterByBoolMask_20 = List.FilterByBoolMask(list=filterByBoolMask_19.in, mask=eq_17)
activeView_2 = Orchid.RevitProject.Common.Document.ActiveView()
location_7 = Custom[Element.Location+](element=filterByBoolMask_19.in)
code_block_153 = CodeBlock(x=location_7.curves)  # same code as code_block_57
direction_6 = Line.Direction(line=code_block_153.out1)
activeView_3 = Orchid.RevitProject.Common.Document.ActiveView()
plane_9 = Custom[View.Plane](view=activeView_3)
isParallelToPlane_3 = Custom[Vector.IsParallelToPlane](vector=direction_6, plane=plane_9)
filterByBoolMask_21 = List.FilterByBoolMask(list=filterByBoolMask_19.in, mask=isParallelToPlane_3)
element_taggedstatus_6 = Custom[Element TaggedStatus](element=filterByBoolMask_21.in)
elementcentroid_6 = Custom[© ElementCentroid](element=element_taggedstatus_6.NotTagged)
location_8 = Custom[Element.Location+](element=element_taggedstatus_6.NotTagged)
code_block_154 = CodeBlock(x=location_8.curves)  # same code as code_block_57
code_block_155 = CodeBlock { 0.5; }
planeAtParameter_5 = Curve.PlaneAtParameter(curve=code_block_154.out1, param=code_block_155)
code_block_156 = CodeBlock { 0.5; }
pointAtParameter_7 = Curve.PointAtParameter(curve=code_block_154.out1, param=code_block_156)
activeView_4 = Orchid.RevitProject.Common.Document.ActiveView()
plane_10 = Custom[View.Plane](view=activeView_4)
normal_9 = Plane.Normal(plane=plane_10)
code_block_157 = CodeBlock { 90; }
rotate_5 = Geometry.Rotate(geometry=planeAtParameter_5, origin=pointAtParameter_7, axis=normal_9, degrees=code_block_157)
normal_10 = Plane.Normal(plane=rotate_5)
code_block_158 = CodeBlock(z=normal_10) { z.Z; }
code_block_159 = CodeBlock { 0; }
gt_6 = code_block_158 > code_block_159
code_block_160 = CodeBlock { -1; }
ne_5 = code_block_158 != code_block_160
and_6 = gt_6 && ne_5
reverse_8 = Vector.Reverse(vector=normal_10)
scopeIf_8 = Custom[ScopeIf+](test=and_6, True=normal_10, False=reverse_8, lacing=Shortest)
code_block_161 = CodeBlock(x=element_taggedstatus_6.NotTagged) { Revit.Elements.Element.GetParameterValueByName(Revit.Elements.Element.GetParameterValueByName(x,"Type"),"Height")/2; }
translate_7 = Geometry.Translate(geometry=elementcentroid_6, direction=scopeIf_8, distance=code_block_161)
byElementAndLocation_6 = Tag.ByElementAndLocation(view=activeView_2, element=element_taggedstatus_6.NotTagged, location=translate_7)
code_block_162 = CodeBlock { "Type"; }
code_block_163 = CodeBlock { "EST_A_STRUCTURAL FRAMING TAG_ELEVACION"; }
byName_18 = Orchid.RevitProject.Elements.Family.ByName(name=code_block_163)
code_block_164 = CodeBlock { "Tag Viga"; }
byFamilyAndName_7 = FamilyType.ByFamilyAndName(family=byName_18, name=code_block_164)
setParameterByName_16 = Element.SetParameterByName(element=byElementAndLocation_6, parameterName=code_block_162, value=byFamilyAndName_7)

# group: Etiqueta Emplantillado
ʳʰʸᵗʰᵐ_tags = Rhythm.Revit.Elements.Tags.SetLeaderElbowPosition()  # unwired: tag, location
code_block_165 = CodeBlock { "Type"; }
code_block_166 = CodeBlock { "EST_A_STRUCTURAL FOUNDATION TAG_ELEVACION_EMPLANTILLADO"; }
byName_19 = Orchid.RevitProject.Elements.Family.ByName(name=code_block_166)
code_block_167 = CodeBlock { "Emplantillado"; }
byFamilyAndName_8 = FamilyType.ByFamilyAndName(family=byName_19, name=code_block_167)
setParameterByName_17 = Element.SetParameterByName(parameterName=code_block_165, value=byFamilyAndName_8)  # unwired: element
code_block_168 = CodeBlock { "Leader Line"; 1; }
setParameterByName_18 = Element.SetParameterByName(parameterName=code_block_168.out0, value=code_block_168.out1)  # unwired: element
code_block_169 = CodeBlock(x=code_block_78.out1) { x; }
code_block_170 = CodeBlock(x=code_block_169) { x; }
code_block_171 = CodeBlock { "Structural Foundations"; }
byName_20 = Category.ByName(name=code_block_171)
all_elements_of_category_in_view_7 = ElementsOfCategoryInView(Category=byName_20, View=code_block_170)
kind_2 = Custom[StructuralFoundation.Kind](structuralFoundation=all_elements_of_category_in_view_7)  # package Clockwork for Dynamo 2.x; Retrieves the kind of a given structural foundation (isolated, wall, slab).
code_block_172 = CodeBlock { "Slab"; }
eq_18 = kind_2 == code_block_172
name_7 = Element.Name(element=all_elements_of_category_in_view_7)
code_block_173 = CodeBlock { "EMPLANTILLADO"; }
contains = String.Contains(str=name_7, searchFor=code_block_173)
and_7 = eq_18 && contains
filterByBoolMask_22 = List.FilterByBoolMask(list=all_elements_of_category_in_view_7, mask=and_7)
code_block_174 = CodeBlock { null; }
replaceEmptyLists_7 = Custom[List.ReplaceEmptyLists](seq=filterByBoolMask_22.in, Replacement=code_block_174)
code_block_175 = CodeBlock { 0; }
getItemAtIndex_2 = List.GetItemAtIndex(index=code_block_175)  # unwired: list
ZAxis_3 = Vector.ZAxis()
code_block_176 = CodeBlock { -300; }
translate_8 = Geometry.Translate(direction=ZAxis_3@L1, distance=code_block_176@L1, lacing=Longest)  # unwired: geometry
code_block_177 = CodeBlock { 0.5; }
pointAtParameter_8 = Surface.PointAtParameter(u=code_block_177, v=code_block_177)  # unwired: surface
element_surfaces_references = Custom[Element Surfaces References](element=replaceEmptyLists_7)  # package Genius Loci; Retrieve the top, bottom, side surfaces and their associated references of the system family. This doesn't work with cylindrical system families (pipe...)
code_block_178 = CodeBlock(x=element_surfaces_references.Bottom_Surface)
# ---------- code_block_178.designscript (12 lines) ----------
x;
[Imperative]
{
	if(x == null)
	{
		return = [];
	}
	else
	{
		return = DSCore.List.Flatten(x,1);
	}
};
# ----------------------------------------
function_apply_7 = ApplyFunction(func=pointAtParameter_8, arg1=code_block_178.out1)
function_apply_8 = ApplyFunction(func=translate_8, arg1=function_apply_7)
code_block_179 = CodeBlock { null; }
replaceEmptyLists_8 = Custom[List.ReplaceEmptyLists](seq=function_apply_8, Replacement=code_block_179)
code_block_180 = CodeBlock(x=code_block_169) { x; }
plane_11 = Custom[View.Plane](view=code_block_180)
byBestFitThroughPoints = Line.ByBestFitThroughPoints()  # unwired: bestFitPoints
code_block_181 = CodeBlock { 0.5; }
pointAtParameter_9 = Curve.PointAtParameter(param=code_block_181)  # unwired: curve
code_block_182 = CodeBlock { [1,3]; }
getItemAtIndex_3 = List.GetItemAtIndex(index=code_block_182@L2)  # unwired: list
getCropBox = Orchid.RevitProject.Views.View.GetCropBox(view=code_block_180)
function_apply_9 = ApplyFunction(func=getItemAtIndex_3, arg1=getCropBox.Curve)
function_apply_10 = ApplyFunction(func=pointAtParameter_9, arg1=function_apply_9)
function_apply_11 = ApplyFunction(func=byBestFitThroughPoints, arg1=function_apply_10)
code_block_183 = CodeBlock(x=function_apply_11)  # same code as code_block_57
code_block_184 = CodeBlock { 0.5; }
pointAtParameter_10 = Curve.PointAtParameter(curve=code_block_183.out1, param=code_block_184)
direction_7 = Line.Direction(line=code_block_183.out1)
code_block_185 = CodeBlock { 90; }
rotate_6 = Geometry.Rotate(geometry=plane_11@L1, origin=pointAtParameter_10@L1, axis=direction_7@L1, degrees=code_block_185@L1)
normal_11 = Plane.Normal(plane=rotate_6)
code_block_186 = CodeBlock { 50; }
translate_9 = Geometry.Translate(geometry=replaceEmptyLists_8@L2, direction=normal_11@L1, distance=code_block_186@L1, lacing=Longest)
function_apply_12 = ApplyFunction(func=getItemAtIndex_2, arg1=translate_9)
byElementAndLocation_7 = Tag.ByElementAndLocation(view=code_block_170@L1, element=replaceEmptyLists_7@L2, location=function_apply_12@L2, lacing=Longest)
flatten_8 = List.Flatten(list=byElementAndLocation_7)
function_apply_13 = ApplyFunction(func=setParameterByName_18, arg1=flatten_8)
function_apply_14 = ApplyFunction(func=setParameterByName_17, arg1=function_apply_13)
function_apply_15 = ApplyFunction(func=ʳʰʸᵗʰᵐ_tags, arg1=function_apply_14, arg2=replaceEmptyLists_8)
code_block_187 = CodeBlock { true; }

openView = Orchid.RevitProject.Common.Document.OpenView(view=code_block_49.out1)
