# Dynamo graph etiquetadoElevMA_script.dyn (Dynamo 2.3.1.11775)
# packages: Orchid 200.4.0.7938, Clockwork for Dynamo 2.x 2.4.0, archi-lab.net 2022.210.2419, Genius Loci 2020.8.3, Crumple 2022.2.13

activeView = Orchid.RevitProject.Common.Document.ActiveView()
code_block = CodeBlock { "Walls"; }
byName = Category.ByName(name=code_block)
activeView_2 = Orchid.RevitProject.Common.Document.ActiveView()
code_block_2 = CodeBlock(x=activeView_2) { x; }
all_elements_of_category_in_view = ElementsOfCategoryInView(Category=byName, View=code_block_2)
wallType = archilab.Revit.Elements.Walls.WallType(wall=all_elements_of_category_in_view)
kind = Orchid.RevitProject.Elements.WallType.Kind(wallType=wallType)
code_block_3 = CodeBlock { "Basic"; }
eq = kind == code_block_3
filterByBoolMask = List.FilterByBoolMask(list=all_elements_of_category_in_view, mask=eq)
name = Material.Name()  # unwired: material
getMaterials = Element.GetMaterials(element=filterByBoolMask.in)
flatten = List.Flatten(list=getMaterials)
function_apply = ApplyFunction(func=name, arg1=flatten)
code_block_4 = CodeBlock { "Concrete, Cast-in-Place gray"; }
eq_2 = function_apply == code_block_4
filterByBoolMask_2 = List.FilterByBoolMask(list=filterByBoolMask.in, mask=eq_2)
location = Custom[Element.Location+](element=filterByBoolMask_2.in)  # package Clockwork for Dynamo 2.x; Returns the location of an element as point, curve or curve loop, along with some booleans to help filtering the results. Unlike the OOTB Element.GetLocation node, it also retunrs sketch lines of sketch-based elements like floor slabs as well as the element's rotation property.
code_block_5 = CodeBlock(x=location.curves)
# ---------- code_block_5.designscript (12 lines) ----------
x;
[Imperative]
{
	if(x == null)
	{
		return = [];
	}
	else
	{
		return = x;
	}
};
# ----------------------------------------
direction = Line.Direction(line=code_block_5.out1)
activeView_3 = Orchid.RevitProject.Common.Document.ActiveView()
plane = Custom[View.Plane](view=activeView_3)  # package Clockwork for Dynamo 2.x; Retrieves the plane of a given view
isParallelToPlane = Custom[Vector.IsParallelToPlane](vector=direction, plane=plane)  # package Clockwork for Dynamo 2.x; Checks if a given vector is parallel to a given plane
filterByBoolMask_3 = List.FilterByBoolMask(list=filterByBoolMask_2.in, mask=isParallelToPlane)
element_taggedstatus = Custom[Element TaggedStatus](element=filterByBoolMask_3.in)  # package Genius Loci; Identify the tagged and untagged elements. Please note : This doesn't work with areas and spaces.
elementcentroid = Custom[© ElementCentroid](element=element_taggedstatus.NotTagged)  # package Crumple; Returns the centroid of the element's axis-aligned bounding box.
byElementAndLocation = Tag.ByElementAndLocation(view=activeView, element=element_taggedstatus.NotTagged, location=elementcentroid)
code_block_6 = CodeBlock { "Type"; }
code_block_7 = CodeBlock { "EST_A_WALL TAG_ELEVACION_MHA"; }
byName_2 = Orchid.RevitProject.Elements.Family.ByName(name=code_block_7)
code_block_8 = CodeBlock { "Doble Malla"; }
byFamilyAndName = FamilyType.ByFamilyAndName(family=byName_2, name=code_block_8)
setParameterByName = Element.SetParameterByName(element=byElementAndLocation, parameterName=code_block_6, value=byFamilyAndName)
activeView_4 = Orchid.RevitProject.Common.Document.ActiveView()
code_block_9 = CodeBlock { "Structural Framing"; }
byName_3 = Category.ByName(name=code_block_9)
code_block_10 = CodeBlock(x=activeView_2) { x; }
all_elements_of_category_in_view_2 = ElementsOfCategoryInView(Category=byName_3, View=code_block_10)
familyName = Orchid.RevitProject.Elements.Element.FamilyName(element=all_elements_of_category_in_view_2)
code_block_11 = CodeBlock()
# ---------- code_block_11.designscript (5 lines) ----------
[
"EST_M_STRUCTURAL FRAMING_VIGA INVERTIDA",
"EST_M_STRUCTURAL FRAMING_VIGA SEMI INVERTIDA",
"EST_M_STRUCTURAL FRAMING_VIGA TRADICIONAL"
];
# ----------------------------------------
eq_3 = familyName@L1 == code_block_11
anyTrue = Orchid.Common.List.AnyTrue(list=eq_3)
filterByBoolMask_4 = List.FilterByBoolMask(list=all_elements_of_category_in_view_2, mask=anyTrue)
name_2 = Material.Name()  # unwired: material
getMaterials_2 = Element.GetMaterials(element=filterByBoolMask_4.in)
flatten_2 = List.Flatten(list=getMaterials_2)
function_apply_2 = ApplyFunction(func=name_2, arg1=flatten_2)
code_block_12 = CodeBlock { "Concrete, Cast-in-Place gray"; }
eq_4 = function_apply_2 == code_block_12
filterByBoolMask_5 = List.FilterByBoolMask(list=filterByBoolMask_4.in, mask=eq_4)
location_2 = Custom[Element.Location+](element=filterByBoolMask_5.in)
code_block_13 = CodeBlock(x=location_2.curves)  # same code as code_block_5
direction_2 = Line.Direction(line=code_block_13.out1)
activeView_5 = Orchid.RevitProject.Common.Document.ActiveView()
plane_2 = Custom[View.Plane](view=activeView_5)
isParallelToPlane_2 = Custom[Vector.IsParallelToPlane](vector=direction_2, plane=plane_2)
filterByBoolMask_6 = List.FilterByBoolMask(list=filterByBoolMask_5.in, mask=isParallelToPlane_2)
element_taggedstatus_2 = Custom[Element TaggedStatus](element=filterByBoolMask_6.in)
elementcentroid_2 = Custom[© ElementCentroid](element=element_taggedstatus_2.NotTagged)
location_3 = Custom[Element.Location+](element=element_taggedstatus_2.NotTagged)
code_block_14 = CodeBlock(x=location_3.curves)  # same code as code_block_5
code_block_15 = CodeBlock { 0.5; }
planeAtParameter = Curve.PlaneAtParameter(curve=code_block_14.out1, param=code_block_15)
code_block_16 = CodeBlock { 0.5; }
pointAtParameter = Curve.PointAtParameter(curve=code_block_14.out1, param=code_block_16)
activeView_6 = Orchid.RevitProject.Common.Document.ActiveView()
plane_3 = Custom[View.Plane](view=activeView_6)
normal = Plane.Normal(plane=plane_3)
code_block_17 = CodeBlock { 90; }
rotate = Geometry.Rotate(geometry=planeAtParameter, origin=pointAtParameter, axis=normal, degrees=code_block_17)
normal_2 = Plane.Normal(plane=rotate)
code_block_18 = CodeBlock(z=normal_2) { z.Z; }
code_block_19 = CodeBlock { 0; }
gt = code_block_18 > code_block_19
code_block_20 = CodeBlock { -1; }
ne = code_block_18 != code_block_20
and_ = gt && ne
reverse = Vector.Reverse(vector=normal_2)
scopeIf = Custom[ScopeIf+](test=and_, True=normal_2, False=reverse, lacing=Shortest)  # package Clockwork for Dynamo 2.x; A (hopefully) more robust implementation of ScopeIf. Tests a single boolean and returns a value accordingly.
code_block_21 = CodeBlock(x=element_taggedstatus_2.NotTagged) { Revit.Elements.Element.GetParameterValueByName(Revit.Elements.Element.GetParameterValueByName(x,"Type"),"Height")/2; }
translate = Geometry.Translate(geometry=elementcentroid_2, direction=scopeIf, distance=code_block_21)
list_create = List.Create(item0=elementcentroid_2, item1=translate)
transpose = List.Transpose(lists=list_create)
byElementAndLocation_2 = Tag.ByElementAndLocation(view=activeView_4@L1, element=element_taggedstatus_2.NotTagged@L1, location=transpose@L2, lacing=Longest)
transpose_2 = List.Transpose(lists=byElementAndLocation_2)
code_block_22 = CodeBlock { null; }
replaceEmptyLists = Custom[List.ReplaceEmptyLists](seq=transpose_2, Replacement=code_block_22)  # package Clockwork for Dynamo 2.x; Replaces all empty lists within a given list with a substitute
code_block_23 = CodeBlock(x=replaceEmptyLists)
# ---------- code_block_23.designscript (12 lines) ----------
x;
[Imperative]
{
	if(x == null)
	{
		return = [[],[]];
	}
	else
	{
		return = x;
	}
};
# ----------------------------------------
code_block_24 = CodeBlock(x=code_block_23.out1) { x[1]; }
code_block_25 = CodeBlock { "Type"; }
code_block_26 = CodeBlock { "EST_A_STRUCTURAL FRAMING TAG_ELEVACION"; }
byName_4 = Orchid.RevitProject.Elements.Family.ByName(name=code_block_26)
code_block_27 = CodeBlock { "Tag Viga"; }
byFamilyAndName_2 = FamilyType.ByFamilyAndName(family=byName_4, name=code_block_27)
setParameterByName_2 = Element.SetParameterByName(element=code_block_24, parameterName=code_block_25, value=byFamilyAndName_2)
code_block_28 = CodeBlock(x=code_block_23.out1) { x[0]; }
code_block_29 = CodeBlock { "Type"; }
code_block_30 = CodeBlock { "EST_A_STRUCTURAL FRAMING TAG_ELEVACION_ESTRIBO Y LATERAL"; }
byName_5 = Orchid.RevitProject.Elements.Family.ByName(name=code_block_30)
code_block_31 = CodeBlock { "Estribo Simple y Laterales"; }
byFamilyAndName_3 = FamilyType.ByFamilyAndName(family=byName_5, name=code_block_31)
setParameterByName_3 = Element.SetParameterByName(element=code_block_28, parameterName=code_block_29, value=byFamilyAndName_3)
